vi "index.gviweb"   [LabVIEW NXG 3.1.0]
# This template is for the Queued Message Handler design pattern. The Event Handling Loop generates messages based on user interface actions. The Message Handling Loop processes messages generated by the Event Handling Loop, or by other messages. The messages are string values, so new messages can be added easily to the Message Cases case structure in the Message Handling Loop. Each message cluster can also provide an optional value for Message Data,  which is a String that can be swapped to whatever type of data is required.
panel controls:
  "Enable Drives": bool
panel indicators:
  "Connected?": bool
  "Last Result": cluster{"Vote": string, "Count": u16}[]
  "Current Vote Status": cluster{"Stat": string, "Count": u16}[]
  "Enabled?": bool
types:
  T1 = cluster{"Vote Frequency (s)": f64, "Time Remaining": f64, "# Voters": i32, "Vote Count": i32}
uses:
  Library::Message Queue::Create All Message Queues.gviweb
  Library::Message Queue::Enqueue Message (Single).gviweb
  Library::Message Queue::Dequeue Message.gviweb
  Library::Message Queue::Enqueue Message (Array).gviweb
  NI::WebSockets::Close WebSocket.gvi
  NI::G Core::Error::Clear Error Cluster.gvi
  Library::GetHostname.jsli::GetHostname
  NI::WebSockets::Open WebSocket.gvi
  NI::WebSockets::Write String.gvi
  NI::WebSockets::Read String.gvi
  NI::G Core::Error::Read Error Code.gvi
  NI::G Core::Error::Build Error Cluster.gvi
diagram:
  call "Create All Message Queues.gviweb"() -> (message queues=w1, error out=w2)
  Property Node(instance in=w1) -> ("UI"=w3)
  while {
    event {
      on "Enable Drives" Value changed {
        Event Data() -> ("New Value"=w5)
        Boolean To Integer(Boolean=w5) -> (0, 1=w6)
        Format Into String(formatString="%d", w6) -> w7
        call "Enqueue Message (Single).gviweb"(message queue in=w3, message="Enable Drives", message data=w7) -> (message queue out=w8, error out=w4)
      }
    }
    stop if FALSE
  }
  w9 = cluster{"Connected?": bool, "websocket": u32} {all zero or empty}
  s1 = w9  # shift register
  while {
    call "Dequeue Message.gviweb"(message queue in=w3, error in=w2) -> (message queue out=w10, message=w11, message data=w12, error out=w13)
    # s1: Data
    case (w11) ignore case {  # Message Cases
      frame "Initialise" {
        Property Node(instance in=s1, "Connected?"=FALSE) -> (instance out=w15)
        $"Current Vote Status" <- cluster{"Stat": string, "Count": f64}[] []
        $"Last Result" <- cluster{"Vote": string, "Count": f64}[] []
        call "Enqueue Message (Array).gviweb"(message queue in=w10, message array=["Update Display", "Connect"], error in=w13) -> (error out=w14)
      }
      frame "Connect" {
        Property Node(instance in=s1) -> ("websocket"=w16, instance out=w17)
        call "Close WebSocket.gvi"(websocket session in=w16, error in=w13) -> (error out=w18)
        call "Clear Error Cluster.gvi"(error in=w18) -> (error out=w19)
        call "GetHostname"(error in=w19) -> (return=w20, error out=w21)
        Format Into String(formatString="ws://%s:6123/", errIn=w21, w20) -> (outString=w22, errOut=w23)
        call "Open WebSocket.gvi"(url=w22, error in=w23) -> (websocket session out=w24, error out=w25)
        case (w25) {
          frame Error, Default {
            Wait(time to wait=1000)
            call "Enqueue Message (Single).gviweb"(message queue in=w10, message="Connect") -> (error out=w26)
            Merge Errors(w26, w25) -> (error out=w14)
            w15 = w17
          }
          frame No Error {
            Property Node(instance in=w17, "Connected?"=TRUE, "websocket"=w24) -> (instance out=w15)
            call "Enqueue Message (Array).gviweb"(message queue in=w10, message array=["Update Display", "Read"], error in=w25) -> (error out=w14)
          }
        }
      }
      frame "Enable Drives" {
        Property Node(instance in=s1) -> ("websocket"=w27, instance out=w15)
        w28 = cluster{"command": string, "data": string} {all zero or empty}
        Property Node(instance in=w28, "command"=w11, "data"=w12) -> (instance out=w29)
        Flatten To JSON(anything=w29, error in (no error)=w13) -> (JSON string=w30, error out=w31)
        call "Write String.gvi"(websocket session in=w27, string message=w30, error in=w31) -> (error out=w14)
      }
      frame "Update Display" {
        Property Node(instance in=s1) -> ("Connected?"=w32, instance out=w15)
        Not(x=w32) -> w33
        Property Node(instance in=reference to "Current Vote Status", "Disabled"=w33)
        Property Node(instance in=reference to "Last Result", "Disabled"=w33)
        $"Connected?" <- w32
        w14 = w13
      }
      frame "Read" {
        Property Node(instance in=s1) -> ("websocket"=w34, instance out=w15)
        call "Read String.gvi"(websocket session in=w34, timeout=0.1, error in=w13) -> (string response=w35, error out=w36)
        call "Read Error Code.gvi"(error in=w36) -> (code=w37)
        case (w37) {
          frame Default {
            call "Enqueue Message (Single).gviweb"(message queue in=w10, message="Disconnected") -> (error out=w38)
            Merge Errors(w38, w36) -> (error out=w14)
          }
          frame 0 {
            Unflatten From JSON(JSON string=w35, error in (no error)=w36, path=["command"], type and defaults=string "") -> (error out=w39, value=w40)
            case (w40) ignore case {
              frame Default {
                Format Into String(formatString="Unrecognised JSON command '%s'", errIn=w39, w40) -> (outString=w42, errOut=w43)
                call "Build Error Cluster.gvi"(error in=w43, code=1, description=w42) -> (error out=w41)
              }
              frame "Vote Starts" {
                w41 = w39
              }
              frame "Voting Ended" {
                Unflatten From JSON(JSON string=w35, error in (no error)=w39, path=["data"], type and defaults=cluster{"Vote": string, "Count": i32}[] []) -> (error out=w41, value=w44)
                $"Last Result" <- w44
              }
              frame "Vote Status" {
                Unflatten From JSON(JSON string=w35, error in (no error)=w39, path=["data"], type and defaults=T1 {all zero or empty}) -> (error out=w41, value=w45)
                Property Node(instance in=w45) -> ("Time Remaining"=w46, "Vote Frequency (s)"=w47, "# Voters"=w48, "Vote Count"=w49)
                Divide(x=w46, y=w47)
                Build Array(w49, w48) -> w50
                for {
                  w51 = each element of ["# Votes Cast", "Electorate Size"]
                  w52 = each element of w50
                  Build Cluster(w51, w52) -> w54
                  append w54 to w53
                }
                $"Current Vote Status" <- w53
              }
              frame "Drive Status" {
                Unflatten From JSON(JSON string=w35, error in (no error)=w39, path=["data"], type and defaults=bool FALSE) -> (error out=w41, value=w55)
                $"Enabled?" <- w55
              }
            }
            call "Enqueue Message (Single).gviweb"(message queue in=w10, message="Read", error in=w41) -> (error out=w14)
          }
          frame 56 {
            call "Clear Error Cluster.gvi"(error in=w36) -> (error out=w56)
            call "Enqueue Message (Single).gviweb"(message queue in=w10, message="Read", error in=w56) -> (error out=w14)
          }
        }
      }
      frame "Disconnected" {
        Property Node(instance in=s1, "Connected?"=FALSE) -> ("websocket"=w57, instance out=w15)
        call "Close WebSocket.gvi"(websocket session in=w57) -> (error out=w58)
        call "Clear Error Cluster.gvi"(error in=w58)
        $"Current Vote Status" <- cluster{"Stat": string, "Count": f64}[] []
        # ignore errors
        $"Last Result" <- cluster{"Vote": string, "Count": f64}[] []
        call "Enqueue Message (Array).gviweb"(message queue in=w10, message array=["Update Display", "Connect"], error in=w13) -> (error out=w14)
      }
      frame "Error" {
        w14 = w13
        w15 = s1
      }
      frame "---Copy This Frame---" {
        Merge Errors(w13) -> (error out=w14)
        w15 = s1
      }
      frame Default {
        w59 = "The invalid message string \"%s\" was received in the Message Handling Loop."
        Format Into String(formatString=w59, w11) -> w60
        call "Build Error Cluster.gvi"(code=1, description=w60) -> (error out=w14)
        w15 = s1
      }
    }
    next s1 = w15
    stop if FALSE
  }
  Merge Errors(w4, w14)
